# Grasshopper definition 潞城.gh (Grasshopper 1.0.7)
# plug-ins: SpaceLayout

# ---- group: 建设用地
crv = Curve(<curve referenced from the Rhino model>)
crv_2 = Curve(<curve referenced from the Rhino model>)
用地 = 用地生成(
    用地边界=crv,
    用地退线=crv_2,
    建筑密度=Slider(0.4, range=0..1),
    容积率=Slider(1, range=0..5),
    建筑限高=Slider(24, range=0..100),
    最大地上建筑面积=Slider(32150, range=0..100000),
    上层偏移距离=Slider(4, range=0..100))

# ---- group: 篮球训练馆
pt = Point(<point referenced from the Rhino model>)
通用球馆 = 创建通用类球馆(
    场馆名称="篮球训练馆",
    是否设置此馆=Toggle(True),
    场地数量=Slider(4, range=0..100),
    场馆面积=Slider(4870, range=0..5000),
    是否设置专属辅助用房=Toggle(True),
    球场划分率=Slider(0.15, range=0..1),
    陈列基点=pt,
    是否多功能=Toggle(True))  # -> 场馆边界, 球场, 辅助用房, 建筑场馆; disabled

# ---- group: 游泳馆
list = ValueList({"Zero": 0, "One": 1, "Two": 2}, selected="Two")
list_2 = ValueList({"Zero": 0, "One": 1}, selected="Zero")
list_3 = ValueList({"Zero": 0, "One": 1, "Two": 2}, selected="One")
pt_2 = Point(<point referenced from the Rhino model>)
游泳馆 = 创建游泳馆(
    是否设置此馆=Toggle(True),
    场馆面积=Slider(6070, range=0..30000),
    标准泳池数量=list,
    标准泳池泳道数量=[Slider(8, range=0..10), Slider(4, range=0..10)],
    非标泳池数量=list_2,
    非标泳池泳道数量=Slider(8, range=0..10),
    儿童戏水池数量=list_3,
    球场划分率=Slider(0, range=0..1),
    陈列基点=pt_2)  # -> 场馆边界, 泳池边界, 辅助用房, 游泳馆; disabled

# ---- group: 羽毛球馆
pt_3 = Point(<point referenced from the Rhino model>)
通用球馆_2 = 创建通用类球馆(
    场馆名称="羽毛球馆",
    是否设置此馆=Toggle(True),
    场地数量=Slider(16, range=0..100),
    场馆面积=Slider(5070, range=0..6000),
    是否设置专属辅助用房=Toggle(True),
    球场划分率=Slider(0.2, range=0..1),
    陈列基点=pt_3,
    是否多功能=Toggle(False))  # -> 场馆边界, 球场, 辅助用房, 建筑场馆; disabled

# ---- group: 网球馆
pt_4 = Point(<point referenced from the Rhino model>)
通用球馆_3 = 创建通用类球馆(
    场馆名称="网球馆",
    是否设置此馆=Toggle(True),
    场地数量=Slider(4, range=0..100),
    场馆面积=Slider(3770, range=0..5000),
    是否设置专属辅助用房=Toggle(True),
    球场划分率=Slider(0.14, range=0..1),
    陈列基点=pt_4,
    是否多功能=Toggle(False))  # -> 场馆边界, 球场, 辅助用房, 建筑场馆; disabled

# ---- group: 冰球馆
pt_5 = Point(<point referenced from the Rhino model>)
通用球馆_4 = 创建通用类球馆(
    场馆名称="冰球馆",
    是否设置此馆=Toggle(True),
    场地数量=Slider(1, range=0..100),
    场馆面积=Slider(3550, range=0..5000),
    是否设置专属辅助用房=Toggle(True),
    球场划分率=Slider(0, range=0..1),
    陈列基点=pt_5,
    是否多功能=Toggle(False))  # -> 场馆边界, 球场, 辅助用房, 建筑场馆; disabled

# ---- group: 健身馆
pt_6 = Point(<point referenced from the Rhino model>)
健身馆 = 创建健身馆(
    是否设置此馆=Toggle(True),
    场馆面积=Slider(3800, range=0..100000),
    是否设置专属辅助用房=Toggle(True),
    场地与辅助用房比=Slider(0.76, range=0..1),
    陈列基点=pt_6)  # -> 场馆边界, 球场, 辅助用房, 建筑场馆; disabled

# ---- group: 大厅
pt_7 = Point(<point referenced from the Rhino model>)
创建大厅 = 创建大厅群组(大厅面积=Slider(3530, range=0..10000), 大厅最小面积=Slider(300, range=0..1000), 陈列基点=pt_7)  # -> 大厅管理类, 场馆边界; disabled

# ----
trigger = Trigger(Interval=10, TimerInterval=10, Target=_1f布局移动)
trigger_2 = Trigger(Interval=-1, TimerInterval=5, Target=[通用球馆, 通用球馆_2, 通用球馆_3, 通用球馆_4, 健身馆, 创建大厅, 游泳馆])  # disabled

# ---- group: 监控
控制器 = 回合控制器(成功次数=Slider(100, range=0..1000), 启用自动计算=Toggle(False), 初始化计算环境=Toggle(False))
panel = Panel(控制器)

# ---- group: 空间布局过程
数据准备 = 建筑布局数据准备(建筑场馆=[通用球馆.建筑场馆, 通用球馆_2.建筑场馆, 通用球馆_3.建筑场馆, 通用球馆_4.建筑场馆, 游泳馆.游泳馆, 健身馆.建筑场馆, 创建大厅.大厅管理类])  # disabled
_1f = 首层平面布局(各层建筑表单是否完成计算=数据准备)  # -> 运行状态, 首层中心点, 场馆单体, 场地, 辅助; disabled
_1f布局移动 = 首层建筑单体移动(上一步操作是否成功=_1f.运行状态)  # -> 首层中心点, 场馆单体, 场地, 辅助, _1FOK
上层布局移动 = 上层建筑单体移动(首层布局是否完成=_1f布局移动._1FOK)  # disabled
评价 = 方案评价(上一步骤是否成功完成=上层布局移动)  # disabled
panel_2 = Panel(评价)

# ---- group: 成果展示
pt_8 = Point(<point referenced from the Rhino model>)
展示 = 成果展示(是否开始=Button(), 展示基点=pt_8, 拷贝编号=Slider(0, range=0..10))  # -> 场馆形体, 场馆形体_2
box = Box(展示.场馆形体)
